# Grasshopper definition dented_cube.gh (Grasshopper 1.0.7)
# plug-ins: Karamba, LunchBox

number_slider = Slider(150, range=0..1000)
xy_plane = XYPlane(Origin=Point(0, 0, 0))
center_box = CenterBox(Base=xy_plane, X=Slider(150, range=0..1000), Y=Slider(150, range=0..1000), Z=number_slider)
multiplication = Multiplication(A=number_slider, B="2")
deconstruct_brep = DeconstructBrep(Brep=center_box)  # -> Faces, Edges, Vertices
number_slider_2 = Slider(5, range=0..5)
quad_panels = QuadPanels(Surface=deconstruct_brep.Faces, UDivisions=Slider(5, range=0..10), VDivisions=Slider(5, range=0..10))  # -> simplify(Panels)
construct_path = ConstructPath(Indices=number_slider_2)
division = Division(A=multiplication, B=number_slider_2)
tree_branch = TreeBranch(Tree=quad_panels, Path=construct_path, MaintainPaths=True)
list_length = ListLength(List=tree_branch)
division_2 = Division(A=list_length, B="2")
multiplication_2 = Multiplication(A=division, B=Slider(4, range=1..5))
round = Round(Number=division_2)  # -> Nearest, Floor, Ceiling
unit_z = UnitZ(Factor=multiplication_2)
list_item = ListItem(List=tree_branch, Index=round.Floor, Wrap=True)
negative = Negative(Value=unit_z)
move = Move(Geometry=list_item, Motion=negative)  # -> Geometry, Transform
deconstruct_brep_2 = DeconstructBrep(Brep=list_item)  # -> Faces, Edges, Vertices
deconstruct_brep_3 = DeconstructBrep(Brep=move.Geometry)  # -> Faces, Edges, Vertices
merge = Merge(Data1=graft(deconstruct_brep_2.Edges), Data2=graft(deconstruct_brep_3.Edges))  # -> simplify(Result)
fit_loft = FitLoft(Curves=merge, CountU=15, DegreeU=5, DegreeV=5)
quad_panels_2 = QuadPanels(Surface=fit_loft, UDivisions=Slider(1, range=0..10), VDivisions=Slider(4, range=0..10))  # -> simplify(Panels)
brep = Brep(quad_panels_2)
brep_2 = Brep(quad_panels)
merge_2 = Merge(Data1=brep_2, Data2=brep)  # -> flatten(Result)
deconstruct_brep_4 = DeconstructBrep(Brep=merge_2)  # -> Faces, Edges, Vertices
remove_duplicate_lines_karamba3d = RemoveDuplicateLinesKaramba3D(Line=flatten(deconstruct_brep_4.Edges), LimitDistance=0.005)  # -> OutLine, Info, Indexes
curve = Curve(remove_duplicate_lines_karamba3d.OutLine)
